# Dynamo graph Baitap1.dyn (Dynamo 2.10.1.3976)

code_block = CodeBlock { 0; }
number_slider = DoubleSlider(135, range=50..200 step 5)
code_block_2 = CodeBlock { 5; }
code_block_3 = CodeBlock(a=code_block, b=number_slider, c=code_block_2) { a..b..c; }
number_slider_2 = DoubleSlider(80, range=30..100 step 10)
code_block_4 = CodeBlock { 30; }
count = List.Count(list=code_block_3)
code_block_5 = CodeBlock { 1; }
code_block_6 = CodeBlock(a=code_block_4, count=count, b=code_block_5) { a..count+a..b; }
byCoordinates = Point.ByCoordinates(x=code_block_3, y=number_slider_2, z=code_block_6)
code_block_7 = CodeBlock(a=number_slider_2) { 2*a; }
byCoordinates_2 = Point.ByCoordinates(x=code_block_3, y=code_block_7, z=code_block_6)
code_block_8 = CodeBlock { 1; }
dropItems = List.DropItems(list=byCoordinates_2, amount=code_block_8)
byStartPointEndPoint = Line.ByStartPointEndPoint(startPoint=byCoordinates, endPoint=dropItems)
byCoordinates_3 = Point.ByCoordinates(x=code_block_3, z=code_block_6)
code_block_9 = CodeBlock { 1; }
dropItems_2 = List.DropItems(list=byCoordinates_3, amount=code_block_9)
byStartPointEndPoint_2 = Line.ByStartPointEndPoint(startPoint=byCoordinates, endPoint=dropItems_2)
code_block_10 = CodeBlock { 1; }
dropItems_3 = List.DropItems(list=byCoordinates, amount=code_block_10)
byStartPointEndPoint_3 = Line.ByStartPointEndPoint(startPoint=dropItems_3, endPoint=byCoordinates_3)
byStartPointEndPoint_4 = Line.ByStartPointEndPoint(startPoint=dropItems_3, endPoint=byCoordinates_2)
code_block_11 = CodeBlock(a=number_slider) { 2*a; }
code_block_12 = CodeBlock(a=number_slider, b=code_block_11, c=code_block_2) { a..b..c; }
reverse = List.Reverse(list=code_block_6)
code_block_13 = CodeBlock { 1; }
dropItems_4 = List.DropItems(list=reverse, amount=code_block_13)
byCoordinates_4 = Point.ByCoordinates(x=code_block_12, y=number_slider_2, z=dropItems_4)
byCoordinates_5 = Point.ByCoordinates(x=code_block_12, y=code_block_7, z=dropItems_4)
code_block_14 = CodeBlock { 1; }
dropItems_5 = List.DropItems(list=byCoordinates_5, amount=code_block_14)
byStartPointEndPoint_5 = Line.ByStartPointEndPoint(startPoint=byCoordinates_4, endPoint=dropItems_5)
code_block_15 = CodeBlock { 1; }
dropItems_6 = List.DropItems(list=byCoordinates_4, amount=code_block_15)
byStartPointEndPoint_6 = Line.ByStartPointEndPoint(startPoint=dropItems_6, endPoint=byCoordinates_5)
byCoordinates_6 = Point.ByCoordinates(x=code_block_12, z=dropItems_4)
byStartPointEndPoint_7 = Line.ByStartPointEndPoint(startPoint=dropItems_6, endPoint=byCoordinates_6)
code_block_16 = CodeBlock { 1; }
dropItems_7 = List.DropItems(list=byCoordinates_6, amount=code_block_16)
byStartPointEndPoint_8 = Line.ByStartPointEndPoint(startPoint=byCoordinates_4, endPoint=dropItems_7)
code_block_17 = CodeBlock { 0; }
code_block_18 = CodeBlock { 3; }
code_block_19 = CodeBlock(a=code_block_17, b=count, c=code_block_18) { a..b..c; }
getItemAtIndex = List.GetItemAtIndex(list=byCoordinates_3, index=code_block_19)
getItemAtIndex_2 = List.GetItemAtIndex(list=byCoordinates_6, index=code_block_19)
code_block_20 = CodeBlock { 1; }
dropItems_8 = List.DropItems(list=getItemAtIndex_2, amount=code_block_20)
list_create = List.Create(item0=getItemAtIndex, item1=dropItems_8)
flatten = List.Flatten(list=list_create)
code_block_21 = CodeBlock(a=code_block_2, b=code_block_18) { a*b; }
code_block_22 = CodeBlock(a=code_block_17, b=code_block_11, c=code_block_21) { a..b..c; }
code_block_23 = CodeBlock { 0; }
byCoordinates_7 = Point.ByCoordinates(x=code_block_22, z=code_block_23)
byStartPointEndPoint_9 = Line.ByStartPointEndPoint(startPoint=flatten, endPoint=byCoordinates_7)
getItemAtIndex_3 = List.GetItemAtIndex(list=byCoordinates, index=code_block_19)
getItemAtIndex_4 = List.GetItemAtIndex(list=byCoordinates_4, index=code_block_19)
code_block_24 = CodeBlock { 1; }
dropItems_9 = List.DropItems(list=getItemAtIndex_4, amount=code_block_24)
list_create_2 = List.Create(item0=getItemAtIndex_3, item1=dropItems_9)
flatten_2 = List.Flatten(list=list_create_2)
byCoordinates_8 = Point.ByCoordinates(x=code_block_22, y=number_slider_2, z=code_block_23)
byStartPointEndPoint_10 = Line.ByStartPointEndPoint(startPoint=flatten_2, endPoint=byCoordinates_8)
getItemAtIndex_5 = List.GetItemAtIndex(list=byCoordinates_2, index=code_block_19)
getItemAtIndex_6 = List.GetItemAtIndex(list=byCoordinates_5, index=code_block_19)
code_block_25 = CodeBlock { 1; }
dropItems_10 = List.DropItems(list=getItemAtIndex_6, amount=code_block_25)
list_create_3 = List.Create(item0=getItemAtIndex_5, item1=dropItems_10)
flatten_3 = List.Flatten(list=list_create_3)
byCoordinates_9 = Point.ByCoordinates(x=code_block_22, y=code_block_7, z=code_block_23)
byStartPointEndPoint_11 = Line.ByStartPointEndPoint(startPoint=flatten_3, endPoint=byCoordinates_9)
